# Grasshopper definition L2.gh (Grasshopper 1.0.8)

topoffset = Slider(5.162, range=-50..200)
baseoffset = Slider(0, range=-50..50)
innerscale = Slider(0.899, range=0.1..0.99)
numlayers = Slider(9.08, range=3..40)
wallthickness = Slider(1.739, range=0.5..5)
smoothness = Slider(1.36, range=1..5)
radius = Slider(5, range=5..100)
twist = Slider(6.487, range=0..180)
sides = Slider(9.054, range=3..20)
height = Slider(20, range=20..400)
pt = Point(Point(0, 0, 0))
multiplication = Multiplication(A=numlayers, B=smoothness)
expression = Expression(x=height, y=multiplication, Expression="x / (y - 1)")
polygon = Polygon(Plane=PlaneXY(0, 0, 0), Radius=radius, Segments=sides, FilletRadius=0)  # -> Polygon, Length
series = Series(Start=baseoffset, Step=expression, Count=numlayers)
Z = UnitZ(Factor=series)
expression_2 = Expression(x=series, y=multiplication, z=twist, Expression="(x / y) * z")
move = Move(Geometry=polygon.Polygon, Motion=Z)  # -> Geometry, Transform
rotate = Rotate(Geometry=move.Geometry, Angle=expression_2, Plane=PlaneXY(0, 0, 0))  # -> Geometry, Transform
scale = Scale(Geometry=rotate.Geometry, Center=pt, Factor=innerscale)  # -> Geometry, Transform
outerloft = Loft(Curves=rotate.Geometry, Options={Adjust=False, Closed=False, LoftEnds=0, LoftSimp=0, LoftType=0, Rebuild=10, Refit=0.01})
innerloft = Loft(Curves=scale.Geometry, Options={Adjust=False, Closed=False, LoftEnds=0, LoftSimp=0, LoftType=0, Rebuild=10, Refit=0.01})
sdiff = SolidDifference(BrepsA=outerloft, BrepsB=innerloft)
cap = CapHoles(Brep=sdiff)
model = Brep(cap)
merge = Merge(Data1=outerloft, Data2=scale.Geometry, Data3=innerloft, Data4=sdiff, Data5=cap, Data6=model, Data7=rotate.Geometry)
bbox = BoundingBox(Content=merge, Plane=PlaneXY(0, 0, 0))  # -> Box, Box_2
debox = DeconstructBox(Box=bbox.Box)  # -> Plane, X, Y, Z
dedomain = DeconstructDomain(Domain=debox.Z)  # -> Start, End
thickness = Slider(3, range=0..10)
height_2 = Subtraction(A=dedomain.End, B=dedomain.Start)
base_z = Addition(A=dedomain.Start, B=baseoffset)
top_z = Addition(A=dedomain.End, B=topoffset)
Z_2 = UnitZ(Factor=1)
mini_slices = Slider(0, range=0..10)
contour = Contour(Shape=merge, Point=debox.Plane, Direction=Z_2, Distance=thickness)  # -> flatten(Contours)
area = Area(Geometry=contour)  # -> Area, Centroid
lng = ListLength(List=flatten(contour))  # -> flatten(Length)
star = Slider(0, range=0..10)
smaller = SmallerThan(FirstNumber=area.Area, SecondNumber=flatten(lng))  # -> SmallerThan, OrEqualTo
not = LogicalNotFilter(Filter=smaller.SmallerThan)
cull = CullPattern(List=not, CullPattern=[False, False, True, True])  # -> flatten(List)
series_2 = Series(Start=flatten(star), Step=flatten(thickness), Count=flatten(lng))
panel = Panel(star)
multiplication_2 = Multiplication(A=series_2, B=thickness)
X = UnitX(Factor=1)
multiplication_3 = Multiplication(A=multiplication_2, B=X)
move_2 = Move(Geometry=contour, Motion=multiplication_3)  # -> Geometry, Transform
