# Grasshopper definition M3.gh (Grasshopper 1.0.8)

tabletopthickness = Slider(3.784, range=1..10)
boxsizez = Slider(0, range=0..60)
tabletoproundness = Slider(12.203, range=0..40)
legradtop = Slider(5, range=0.5..5)
fillet_radius = Slider(29.272, range=0..40)
tabletopheight = Slider(13.34, range=0..60)
leginset = Slider(6.527, range=0..20)
boxsizez_2 = Slider(0, range=0..60)
leghieght = Slider(-13.34, range=-40..50)
legradbottom = Slider(3.043, range=0.5..5)
numlegs = Slider(4, range=3..8)
boxsizex = Slider(60, range=0..60)
boxsizey = Slider(60, range=0..60)
# Parameters for the table itself
boxsizez_3 = Slider(60, range=0..60)
Z = UnitZ(Factor=1)
# A boundary box to make sure the model I create stays within the parameters: 60 mm x 60 mm x 60 mm
pt = ConstructPoint(XCoordinate=boxsizez_2, YCoordinate=boxsizez, ZCoordinate=0)
pt_2 = ConstructPoint(XCoordinate=0, YCoordinate=0, ZCoordinate=tabletopheight)
rectangle = Rectangle(Plane=pt, XSize=boxsizex, YSize=boxsizey, Radius=0)  # -> Rectangle, Length
pi = Pi(Factor=1)
multiplication = Multiplication(A=boxsizez_3, B=Z)
x1 = Slider(6, range=0..10)
x2 = Slider(3, range=0..10)
boundary = BoundarySurfaces(Edges=rectangle.Rectangle)
rectangle_2 = Rectangle(Plane=pt_2, XSize=boxsizex, YSize=boxsizey, Radius=0)  # -> Rectangle, Length
Z_2 = UnitZ(Factor=1)
multiplication_2 = Multiplication(A=pi, B=2)
extr = Extrude(Base=boundary, Direction=multiplication)
panel = Panel("Table top")
amp = Amplitude(Vector=Z_2, Amplitude=tabletopthickness)
fillet = Fillet(Curve=rectangle_2.Rectangle, Radius=tabletoproundness)
dom = ConstructDomain(DomainStart=0, DomainEnd=multiplication_2)
extr_2 = Extrude(Base=fillet, Direction=amp)
# Math for the Parametric Flower
# 
# Equations: x = scale * cos(x1*r) * cos(x2*r) and y = scale * cos(x1*r) * sin(x2*r)
range = Range(Domain=dom, Steps=Slider(200, range=0..200))
x1_r = Multiplication(A=x1, B=range)
x2_r = Multiplication(A=x2, B=range)
sin = Sine(Value=x2_r)
cos = Cosine(Value=x1_r)
cos_2 = Cosine(Value=x2_r)
scale = Slider(24.139, range=5..30)
top_brep = CapHoles(Brep=extr_2)
multiplication_3 = Multiplication(A=cos, B=cos_2)
multiplication_4 = Multiplication(A=cos, B=sin)
X = Multiplication(A=multiplication_3, B=scale)
Y = Multiplication(A=multiplication_4, B=scale)
# Moves the legs to the center of the table, and allows for different numbers of legs
area = Area(Geometry=rectangle_2.Rectangle)  # -> Area, Centroid
division = Division(A=boxsizex, B=2)
subtraction = Subtraction(A=division, B=leginset)
pt_3 = ConstructPoint(XCoordinate=X, YCoordinate=Y, ZCoordinate=0)  # -> flatten(Point)
Z_3 = UnitZ(Factor=1)
polygon = Polygon(Plane=area.Centroid, Radius=subtraction, Segments=numlegs, FilletRadius=0)  # -> Polygon, Length
intcrv = Interpolate(Vertices=pt_3, Degree=3, Periodic=Toggle(True), KnotStyle=1)  # -> Curve, Length, Domain
amp_2 = Amplitude(Vector=Z_3, Amplitude=tabletopthickness)
area_2 = Area(Geometry=top_brep)  # -> Area, Centroid
Z_4 = UnitZ(Factor=1)
explode = Explode(Curve=polygon.Polygon, Recursive=True)  # -> Segments, Vertices
# Parametric flower on top of table
move = Move(Geometry=intcrv.Curve, Motion=area_2.Centroid)  # -> Geometry, Transform
move_2 = Move(Geometry=move.Geometry, Motion=amp_2)  # -> Geometry, Transform
multiplication_5 = Multiplication(A=Z_4, B=Slider(-3.765, range=-50..50))
boundary_2 = BoundarySurfaces(Edges=move_2.Geometry)
extr_3 = Extrude(Base=boundary_2, Direction=multiplication_5)
division_2 = Division(A=boxsizex, B=2)
cap = CapHoles(Brep=extr_3)
subtraction_2 = Subtraction(A=division_2, B=leginset)
top_brep_pattern = SolidDifference(BrepsA=top_brep, BrepsB=cap)
Z_5 = UnitZ(Factor=1)
subtraction_3 = Subtraction(A=tabletopheight, B=tabletopthickness)
brep = Brep(top_brep_pattern)
polygon_2 = Polygon(Plane=PlaneXY(0, 0, 0), Radius=subtraction_2, Segments=numlegs, FilletRadius=0)  # -> Polygon, Length
multiplication_6 = Multiplication(A=Z_5, B=subtraction_3)
panel_2 = Panel("Legs")
explode_2 = Explode(Curve=polygon_2.Polygon, Recursive=True)  # -> Segments, Vertices
move_3 = Move(Geometry=polygon_2.Polygon, Motion=multiplication_6)  # -> Geometry, Transform
Z_6 = UnitZ(Factor=1)
cull_i = CullIndex(List=explode_2.Vertices, Indices=-1, Wrap=True)
Z_7 = UnitZ(Factor=1)
circle = CircleCNR(Center=explode.Vertices, Normal=Z_6, Radius=legradtop)  # -> simplify(graft(Circle))
division_3 = Division(A=legradbottom, B=legradtop)
multiplication_7 = Multiplication(A=Z_7, B=leghieght)
move_4 = Move(Geometry=circle, Motion=multiplication_7)  # -> graft(Geometry), Transform
scale_nu = ScaleNU(Geometry=move_4.Geometry, Plane=circle, ScaleX=division_3, ScaleY=division_3, ScaleZ=1)  # -> simplify(graft(Geometry)), Transform
merge = Merge(Data1=graft(circle), Data2=graft(scale_nu.Geometry))
loft = Loft(Curves=merge, Options={Adjust=False, Closed=False, LoftEnds=0, LoftSimp=0, LoftType=0, Rebuild=10, Refit=0.01})
join = BrepJoin(Breps=loft)  # -> flatten(Breps), Closed
cap_2 = CapHoles(Brep=join.Breps)
merge_2 = Merge(Data1=top_brep_pattern, Data2=cap_2)  # -> flatten(Result)
final_table = SolidUnion(Breps=merge_2)
brep_2 = Brep(final_table)
brep_3 = Brep(cap_2)
